# Grasshopper definition day 1.gh (Grasshopper 1.0.7)

panel = Panel("""157
148
149
146
144
145
162
163
164
166
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""")
shift = ShiftList(List=panel, Shift="1", Wrap=False)
shift_2 = ShiftList(List=panel, Shift="2", Wrap=False)
shift_3 = ShiftList(List=panel, Shift="3", Wrap=False)
division = Division(A=panel, B=2)
pt = ConstructPoint(XCoordinate=0, YCoordinate=0, ZCoordinate=0)
cir = Circle(Plane=pt, Radius=division)
lng = ListLength(List=division)
partition = PartitionList(List=panel, Size="3")
partition_2 = PartitionList(List=shift, Size="3")
partition_3 = PartitionList(List=shift_2, Size="3")
partition_4 = PartitionList(List=shift_3, Size="3")
random = Random(Range=Domain(0, 1), Number=lng, Seed=2)
ma = MassAddition(Input=partition)  # -> Result, PartialResults
ma_2 = MassAddition(Input=partition_2)  # -> Result, PartialResults
ma_3 = MassAddition(Input=partition_3)  # -> Result, PartialResults
ma_4 = MassAddition(Input=partition_4)  # -> Result, PartialResults
eval = EvaluateCurve(Curve=reparameterize(graft(cir)), Parameter=graft(random))  # -> Point, Tangent, Angle
ln = Line(StartPoint=pt, EndPoint=eval.Point)
merge = Merge(Data1=simplify(ma.Result), Data2=simplify(ma_2.Result), Data3=simplify(ma_3.Result), Data4=simplify(ma_4.Result))  # -> flatten(Result)
shift_4 = ShiftList(List=merge, Shift="1", Wrap=True)
subtraction = Subtraction(A=shift_4, B=merge)
larger = LargerThan(FirstNumber=subtraction, SecondNumber="0")  # -> LargerThan, OrEqualTo
dispatch = Dispatch(List=subtraction, DispatchPattern=larger.LargerThan)  # -> ListA, ListB
panel_2 = Panel(dispatch.ListB)
