# Grasshopper definition day 3.gh (Grasshopper 1.0.7)
# plug-ins: Anemone, Pufferfish

panel = Panel("""00100
11110
10110
10111
10101
01111
00111
11100
10000
11001
00010
01010""")
panel_2 = Panel("""101001011000
100000101010
110000011001
010000100111
100111101110
101110000000
001010111010
001101110110
100100001100
101011011010
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""")
chars = Characters(Text=panel_2)  # -> Result, Unicode
flip = FlipMatrix(Data=chars.Result)
panel_3 = Panel(panel_2)
mindex = MemberIndex(Set=flip, Member="1")  # -> Index, Count
number_slider = Slider(12, range=0..12)
toggle = BooleanToggle(False)
panel_4 = Panel("2")
larger = LargerThan(FirstNumber=mindex.Count, SecondNumber="500")  # -> LargerThan, OrEqualTo
loop_start = LoopStart(Repeat=number_slider, Trigger=toggle, Data=panel_3)  # -> port, Counter, Data
loop_start_2 = LoopStart(Repeat=number_slider, Trigger=toggle, Data=panel_3)  # -> port, Counter, Data
weave = Weave(Pattern=larger.LargerThan, Stream0="1", Stream1="0", NullGaps=False)  # -> flatten(Weave)
weave_2 = Weave(Pattern=larger.LargerThan, Stream0="0", Stream1="1", NullGaps=False)  # -> flatten(Weave)
join = TextJoin(Text=weave)
join_2 = TextJoin(Text=weave_2)
chars_2 = Characters(Text=loop_start_2.Data)  # -> Result, Unicode
chars_3 = Characters(Text=loop_start.Data)  # -> Result, Unicode
c_script = CSharpScript(x=join_2)  # -> out, A; inputs x: String
# ---------- c_script: C# usings ----------
using System.Linq;
# ---------- c_script: C# ----------
    A = Convert.ToInt32(x, 2);
# ---------- end c_script ----------
c_script_2 = CSharpScript(x=join)  # -> out, A; inputs x: String; same code as c_script
item = ListItem(List=chars_3.Result, Index=loop_start.Counter, Wrap=True)  # -> flatten(Item)
item_2 = ListItem(List=chars_2.Result, Index=loop_start_2.Counter, Wrap=True)  # -> flatten(Item)
multiplication = Multiplication(A=c_script.A, B=c_script_2.A)
mindex_2 = MemberIndex(Set=item, Member="0")  # -> Index, Count
mindex_3 = MemberIndex(Set=item_2, Member="0")  # -> Index, Count
lng = ListLength(List=item)
lng_2 = ListLength(List=item_2)
division = Division(A=lng, B=2)
division_2 = Division(A=lng_2, B=2)
panel_5 = Panel(multiplication)
smaller = SmallerThan(FirstNumber=mindex_3.Count, SecondNumber=division_2)  # -> SmallerThan, OrEqualTo
larger_2 = LargerThan(FirstNumber=mindex_2.Count, SecondNumber=division)  # -> LargerThan, OrEqualTo
filter = StreamFilter(Gate=larger_2.LargerThan, Stream0="1", Stream1="0")
filter_2 = StreamFilter(Gate=smaller.OrEqualTo, Stream0="1", Stream1="0")
equals = Equality(FirstNumber=filter, SecondNumber=item)  # -> Equality, Inequality
equals_2 = Equality(FirstNumber=filter_2, SecondNumber=item_2)  # -> Equality, Inequality
dispatch = Dispatch(List=loop_start.Data, DispatchPattern=equals.Equality)  # -> ListA, ListB
dispatch_2 = Dispatch(List=loop_start_2.Data, DispatchPattern=equals_2.Equality)  # -> ListA, ListB
lng_3 = ListLength(List=dispatch.ListA)
lng_4 = ListLength(List=dispatch_2.ListA)
equals_3 = Equality(FirstNumber=lng_3, SecondNumber="1")  # -> Equality, Inequality
equals_4 = Equality(FirstNumber=lng_4, SecondNumber="1")  # -> Equality, Inequality
loop_end = LoopEnd(
    port=loop_start.port,
    Exit=equals_3.Equality,
    Data=dispatch.ListA,
    TimeOutVal=0,
    pausedState=False,
    state="Constant & Record")
loop_end_2 = LoopEnd(
    port=loop_start_2.port,
    Exit=equals_4.Equality,
    Data=dispatch_2.ListA,
    TimeOutVal=0,
    pausedState=False,
    state="Constant & Record")
lastdex = LastIndex(List=loop_end)
item_3 = ListItem(List=loop_end_2, Index=0, Wrap=True)  # -> flatten(Item1), flatten(Item)
item_4 = ListItem(List=loop_end, Index=lastdex, Wrap=True)  # -> flatten(Item)
clean = CleanTree(RemoveNulls=True, RemoveInvalid=True, RemoveEmpty=False, Tree=item_3.Item1)
item_5 = ListItem(List=item_4, Index=0, Wrap=True)  # -> Item1, Item
item_6 = ListItem(List=clean, Index=0, Wrap=True)  # -> Item1, Item
panel_6 = Panel(item_5.Item1)
panel_7 = Panel(item_6.Item1)
c_script_3 = CSharpScript(x=item_5.Item1)  # -> A; inputs x: String
# ---------- c_script_3: C# ----------
    A = Convert.ToInt32(x,2);
# ---------- end c_script_3 ----------
c_script_4 = CSharpScript(x=item_6.Item1)  # -> A; inputs x: String; same code as c_script_3
panel_8 = Panel(c_script_4)
panel_9 = Panel(c_script_3)
multiplication_2 = Multiplication(A=c_script_3, B=c_script_4)
panel_10 = Panel(multiplication_2)
